# Grasshopper definition bndreader.gh (Grasshopper 1.0.7)
# plug-ins: jSwan

panel = Panel("! ===============================================================")
bnd_files = FilePath(["C:\Users\BT\Documents\GitHub\bndparser\Boiler_Convector.bnd", "C:\Users\BT\Documents\GitHub\bndparser\DOAS_Preheat.bnd", "C:\Users\BT\Documents\GitHub\bndparser\FCU_Boiler_Chiller.bnd", "C:\Users\BT\Documents\GitHub\bndparser\PTHP.bnd"])
list_item = ListItem(List=bnd_files, Index=Slider(0, range=0..3), Wrap=True)
read_file = ReadFile(File=list_item, PerLineParse=True)
match_text = MatchText(Text=read_file, Pattern=panel, Case=True)
list_length = ListLength(List=match_text)  # -> flatten(Length)
series = Series(Start=0, Step=1, Count=list_length)
cull_pattern = CullPattern(List=series, CullPattern=match_text)  # -> flatten(List)
data = Data(["-1", cull_pattern, list_length])
consecutive_domains = ConsecutiveDomains(Numbers=data, Additive=False)
deconstruct_domain = DeconstructDomain(Domain=consecutive_domains)  # -> Start, End
addition = Addition(A=deconstruct_domain.Start, B=1)
subtraction = Subtraction(A=deconstruct_domain.End, B=1)
construct_domain = ConstructDomain(DomainStart=addition, DomainEnd=subtraction)
sub_list = SubList(List=read_file, Domain=construct_domain, Wrap=True)  # -> simplify(List), Index
text_trim = TextTrim(Text=sub_list.List, Start=True, End=True)
ghpython_script = GhPythonScript(x=text_trim)  # -> a
# ---------- ghpython_script: Python ----------
__author__ = "BT"
__version__ = "2021.02.02"

import rhinoscriptsyntax as rs

if x[0] == "!" or x[0] == "#":
    a = True
else:
    a = False
# ---------- end ghpython_script ----------
gate_not = GateNot(A=ghpython_script)
# Data
cull_pattern_2 = CullPattern(List=sub_list.List, CullPattern=gate_not)
# Comments
cull_pattern_3 = CullPattern(List=sub_list.List, CullPattern=ghpython_script)
explode_tree = ExplodeTree(Data=cull_pattern_3)  # -> Branch0, Branch1, Branch2, Branch3, Branch4, Branch5, Branch6, Branch7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
explode_tree_2 = ExplodeTree(Data=cull_pattern_2)  # -> Branch0, Branch1, Branch2, Branch3, Branch4, Branch5, Branch6, Branch7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
param_viewer = ParamViewer(cull_pattern_2)
serialize_json = SerializeJson(
    ProgramVersion=explode_tree_2.Branch0,
    Nodes=explode_tree_2.Branch1,
    SuspiciousNodes=explode_tree_2.Branch2,
    BranchLists=explode_tree_2.Branch3,
    SupplyAirPaths=explode_tree_2.Branch4,
    ReturnAirPaths=explode_tree_2.Branch5,
    OutdoorAirNodes=explode_tree_2.Branch6,
    ComponentSets=explode_tree_2.Branch7,
    PlantLoops=explode_tree_2.Branch8,
    CondenserLoops=explode_tree_2.Branch9,
    ControlledZones=explode_tree_2.Branch10,
    ZoneEquipmentLists=explode_tree_2.Branch11,
    AirLoopHVACs=explode_tree_2.Branch12,
    ParentNodeConnections=explode_tree_2.Branch13,
    NonParentNodeConnections=explode_tree_2.Branch14,
    IncludeNullAndEmptyProperties=True)
panel_2 = Panel(explode_tree.Branch7)
deserialize_json = DeserializeJson(JSON=serialize_json, OutputsLocked=False)  # -> ProgramVersion, Nodes, SuspiciousNodes, BranchLists, SupplyAirPaths, ReturnAirPaths, OutdoorAirNodes, ComponentSets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
python = GhPythonScript(ComponentSets=deserialize_json.ComponentSets)  # -> Count, ParentObjectType, ParentObjectName, ComponentType, InletNodeID, OutletNodeID, Description
# ---------- python: Python ----------
__author__ = "BT"
__version__ = "2021.02.04"

import json
Count, ParentObjectType, ParentObjectName, ComponentType, InletNodeID, OutletNodeID, Description = ComponentSets.strip().split(",")
# ---------- end python ----------
python_2 = GhPythonScript(Nodes=deserialize_json.Nodes)  # -> ID, Name, FluidType, TimesReferenced
# ---------- python_2: Python ----------
__author__ = "BT"
__version__ = "2021.02.04"

import json
Node, ID, Name, FluidType, TimesReferenced = Nodes.strip().split(",")
# ---------- end python_2 ----------
match_text_2 = MatchText(Text=deserialize_json.BranchLists, RegEx="Branch List", Case=True)

# ----
# Nodes
list_length_2 = ListLength(List=deserialize_json.Nodes)
rectangle = Rectangle({Plane=PlaneXY(25.97099512, 15.23142718, 0), Size=Domain2(u=-21.34183379..21.34183379, v=-11.81266109..11.81266109)})
populate_2d = Populate2D(Region=rectangle, Count=list_length_2, Seed=1)
text_tag = TextTag(Location=populate_2d, Text=python_2.Name)

list_length_3 = ListLength(List=match_text_2)  # -> flatten(Length)
series_2 = Series(Start=0, Step=1, Count=list_length_3)
cull_pattern_4 = CullPattern(List=series_2, CullPattern=match_text_2)  # -> flatten(List)
relative_differences = RelativeDifferences(Values=[cull_pattern_4, list_length_3])
cull_index = CullIndex(List=relative_differences, Indices="0", Wrap=True)
partition_list = PartitionList(List=deserialize_json.BranchLists, Size=cull_index)
cull_pattern_5 = CullPattern(List=deserialize_json.BranchLists, CullPattern=match_text_2)  # -> flatten(List)
cull_index_2 = CullIndex(List=partition_list, Indices="0", Wrap=True)
panel_3 = Panel(explode_tree.Branch3)
python_3 = GhPythonScript(Branch=cull_index_2)  # -> Count, flatten(BranchName), LoopName, LoopType, flatten(BranchInletNodeName), flatten(BranchOutletNodeName)
# ---------- python_3: Python ----------
__author__ = "BT"
__version__ = "2021.02.04"

Branch, Count, BranchName, LoopName, LoopType, BranchInletNodeName, BranchOutletNodeName = Branch.strip().split(",")
# ---------- end python_3 ----------
python_4 = GhPythonScript(BranchList=cull_pattern_5)  # -> Count, BranchName, LoopName, LoopType, NumberOfBranches
# ---------- python_4: Python ----------
__author__ = "BT"
__version__ = "2021.02.04"

BranchList, Count, BranchListName, LoopName, LoopType, NumberOfBranches = BranchList.strip().split(",")
# ---------- end python_4 ----------
match_text_3 = MatchText(Text=python_2.Name, Pattern=graft(python_3.BranchOutletNodeName), Case=True)
match_text_4 = MatchText(Text=python_2.Name, Pattern=graft(python_3.BranchInletNodeName), Case=True)
list_length_4 = ListLength(List=match_text_4)  # -> flatten(Length)
series_3 = Series(Start=0, Step=1, Count=list_length_4)
cull_pattern_6 = CullPattern(List=series_3, CullPattern=match_text_3)  # -> simplify(flatten(List))
cull_pattern_7 = CullPattern(List=series_3, CullPattern=match_text_4)  # -> flatten(List)
# Outlet Node
list_item_2 = ListItem(List=populate_2d, Index=cull_pattern_6, Wrap=True)
# Inlet Node
list_item_3 = ListItem(List=populate_2d, Index=cull_pattern_7, Wrap=True)
# Branch Line
line = Line(StartPoint=list_item_3, EndPoint=list_item_2)
curve_middle = CurveMiddle(Curve=line)
# Branch Name
text_tag_2 = TextTag(Location=curve_middle, Text=python_3.BranchName)
