# Grasshopper definition test_json.gh (Grasshopper 1.0.7)
# plug-ins: jSwan

panel = Panel("""{
    "ProgramVersion": {},
    "Nodes": {
        "Node": [
            "Node",
            "NodeNumber",
            "Node Name",
            "Node Fluid Type",
            "Times Node Referenced After Definition"
        ]
    },
    "SuspiciousNodes": {
        "Suspicious Node": [
            "Suspicious Node",
            "NodeNumber",
            "Node Name",
            "Node Fluid Type",
            "Times Node Referenced After Definition"
        ]
    },
    "BranchLists": {
        "Branch List": [
            "Branch List",
            "Branch List Count",
            "Branch List Name",
            "Loop Name",
            "Loop Type",
            "Number of Branches"
        ],
        "Branch": [
            "Branch",
            "Branch Count",
            "Branch Name",
            "Loop Name",
            "Loop Type",
            "Branch Inlet Node Name",
            "Branch Outlet Node Name"
        ]
    },
    "SupplyAirPaths": {
        "Supply Air Path": [
            "Supply Air Path",
            "Supply Air Path Count",
            "Supply Air Path Name",
            "AirLoopHVAC Name"
        ],
        "Supply Air Path Component Nodes": [
            "Supply Air Path Component",
            "Component Count",
            "Component Type",
            "Component Name",
            "AirLoopHVAC Name"
        ],
        "Supply Air Path Component": [
            "Supply Air Path Component Nodes",
            "Node Count",
            "Component Type",
            "Component Name",
            "Inlet Node Name",
            "Outlet Node Name",
            "AirLoopHVAC Name"
        ]
    },
    "ReturnAirPaths": {
        "Return Air Path": [
            "Return Air Path",
            "Return Air Path Count",
            "Return Air Path Name",
            "AirLoopHVAC Name"
        ],
        "Return Air Path Component Nodes": [
            "Return Air Path Component",
            "Component Count",
            "Component Type",
            "Component Name",
            "AirLoopHVAC Name"
        ],
        "Return Air Path Component": [
            "Return Air Path Component Nodes",
            "Node Count",
            "Component Type",
            "Component Name",
            "Inlet Node Name",
            "Outlet Node Name",
            "AirLoopHVAC Name"
        ]
    },
    "OutdoorAirNodes": {},
    "ComponentSets": {
        "Component Set": [
            "Component Set",
            "Component Set Count",
            "Parent Object Type",
            "Parent Object Name",
            "Component Type",
            "Component Name",
            "Inlet Node ID",
            "Outlet Node ID",
            "Description"
        ]
    },
    "PlantLoops": {
        "Plant Loop Connector Nodes": [
            "Plant Loop",
            "Plant Loop Name",
            "Loop Type",
            "Inlet Node Name",
            "Outlet Node Name",
            "Branch List",
            "Connector List"
        ],
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""")
deserialize_json = DeserializeJson(JSON=panel, OutputsLocked=False)  # -> ProgramVersion, Nodes, SuspiciousNodes, BranchLists, SupplyAirPaths, ReturnAirPaths, OutdoorAirNodes, ComponentSets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
deserialize_json_2 = DeserializeJson(JSON=deserialize_json.AirLoopHVACs, OutputsLocked=False)  # -> AirLoopHVACConnector, AirLoopReturnConnections, OutdoorAirConnections, AirLoopHVACConnectorNodes, AirLoopSupplyConnections, AirLoopHVAC, CooledZoneInfo, HeatedZoneInfo, AirLoopHVACConnectorBranches
deserialize_json_3 = DeserializeJson(JSON=deserialize_json.BranchLists, OutputsLocked=False)  # -> BranchList, Branch
panel_2 = Panel(deserialize_json_2.AirLoopHVACConnector)
